# Grasshopper definition FilterOSM.gh (Grasshopper 1.0.7)
# plug-ins: TwinLand

importosm = ImportOSM(
    Boundary=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,
    FilePath="/Users/jiaqizheng/Desktop/temp/osmFile.osm",
    OSMTag_KeyValue=["natural=water", "natural=heath", "natural=scrub", "natural=beach", "natural=sand"],
    Clipped=True)  # -> Extends, Fields, Values, FeatureGeometry
path_mapper = PathMapper(importosm.FeatureGeometry, source=["{A;B}", "{A;B;C}"], target=["{A;B}", "{A;B}"])
panel = Panel(importosm.Values)
featurematcher = FeatureMatcher(featuregeometry=path_mapper, tag_value=importosm.Values, osm_tag_value="natural=water")
featurematcher_2 = FeatureMatcher(featuregeometry=path_mapper, tag_value=importosm.Values, osm_tag_value="natural=sand")

# ==== cluster FeatureMatcher
osm_tag_value = ClusterInput()  # OSM query format for example, Tag=Value
split = TextSplit(Text=osm_tag_value, Separators="=")
item = ListItem(List=reverse(split), Index=0, Wrap=True)
tag_value = ClusterInput()  # Tag’s value from imported OSM file
textequality = CSharpScript(T1=tag_value, T2=item)  # -> out, A; inputs T1: String, T2: String
# ---------- textequality: C# ----------
A = String.Equals(T1, T2);
# ---------- end textequality ----------
ma = MassAddition(Input=textequality.A)  # -> Result, PartialResults
featuregeometry = ClusterInput()  # FeatureGeometry
cull = CullPattern(List=featuregeometry, CullPattern=ma.Result)
filteredgeometry = ClusterOutput(cull)  # FilteredGeometry
