# Grasshopper definition GetRaster.gh (Grasshopper 1.0.7)
# plug-ins: TwinLand Info

number_slider = Slider(800, range=0..10000)
dom = ConstructDomain(DomainStart=expr("-x", number_slider), DomainEnd=number_slider)
restgeocode = RESTGeocode(Addresses="University of Virginia")  # -> Candidates, Latitude, Longitude
list = ValueList({"ESRI World Imagery": "https://server.arcgisonline.com/ArcGIS/rest/services/World_Imagery/MapServer/export?", "ESRI World Topo Map": "https://server.arcgisonline.com/arcgis/rest/services/World_Topo_Map/MapServer/export?", "ESRI World Physical Map": "https://server.arcgisonline.com/arcgis/rest/services/World_Physical_Map/MapServer/export?", "ESRI World Street Map": "https://server.arcgisonline.com/arcgis/rest/services/World_Street_Map/MapServer/export?", "ESRI World Terrain Base": "https://server.arcgisonline.com/arcgis/rest/services/World_Terrain_Base/MapServer/export?", "ESRI World Shaded Relief": "https://server.arcgisonline.com/arcgis/rest/services/World_Shaded_Relief/MapServer/export?", "ESRI World Dark Gray Base": "https://server.arcgisonline.com/arcgis/rest/services/Canvas/World_Dark_Gray_Base/MapServer/export?", "ESRI World Light Gray Base": "https://server.arcgisonline.com/arcgis/rest/services/Canvas/World_Light_Gray_Base/MapServer/export?", "ESRI World Hillshade": "https://server.arcgisonline.com/arcgis/rest/services/Elevation/World_Hillshade/MapServer/export?", "ESRI World Hillshade Dark": "https://server.arcgisonline.com/arcgis/rest/services/Elevation/World_Hillshade_Dark/MapServer/export?", "ESRI World Boundaries and Places": "https://server.arcgisonline.com/arcgis/rest/services/Reference/World_Boundaries_and_Places/MapServer/export?", "ESRI World Transportation": "https://server.arcgisonline.com/arcgis/rest/services/Reference/World_Transportation/MapServer/export?", "ESRI DeLorme World Base Map": "https://server.arcgisonline.com/arcgis/rest/services/Specialty/DeLorme_World_Base_Map/MapServer/export?", "ESRI NatGeo World Map": "https://server.arcgisonline.com/arcgis/rest/services/NatGeo_World_Map/MapServer/export?", "ESRI USA Topo Maps": "https://server.arcgisonline.com/arcgis/rest/services/USA_Topo_Maps/MapServer/export?"}, selected="ESRI World Imagery")
resolution = ValueList({"None": , "Low": 256, "Med": 512, "High": 1024, "Max": 2048}, selected="Max")
item = ListItem(List=flatten(restgeocode.Latitude), Index=0, Wrap=True)
item_2 = ListItem(List=flatten(restgeocode.Longitude), Index=0, Wrap=True)
rectangle = Rectangle(Plane=PlaneXY(0, 0, 0), XSize=dom, YSize=dom, Radius=0)  # -> Rectangle, Length
seteap = SetEarthAnchorPoint(Set=Toggle(True), Latitude=item, Longitude=item_2)
getraster = GetRaster(
    Boundary=rectangle.Rectangle,
    Resolution=resolution,
    TargetFolder="/Users/jiaqizheng/Desktop/temp",
    Prefix="test",
    RESTURL=list,
    ImageType="jpg",
    Run=Toggle(True))  # -> Image, ImageFrame, RESTQuery
panel = Panel(seteap)
